# Grasshopper definition cedar_floor_planner.gh (Grasshopper 1.0.8)

# ----
# Cedar Floor Planner Solver
# Boundary → Packing → Metrics → JSON
# Input - Editable
# STEP 1 - Choose option to select boundary crv control location
value_list = ValueList({"Boundary on Rhino": 0, "Boundary on gh": 1}, selected="Boundary on Rhino")

# ----
# STEP 2A - To control boundary on rhino, assign curve
# OR
curve = Curve()

length = Slider(25, range=0..100)
width = Slider(10, range=0..100)

# ----
# STEP 2B - To control boundary on gh
rectangle = Rectangle(Plane=PlaneXY(0, 0, 0), XSize=length, YSize=width, Radius=0)  # -> Rectangle, Length
curve_2 = Curve(rectangle.Rectangle)

# ----
# A. Boundary Input
merge = Merge(Data1=curve, Data2=curve_2)
number = Number(value_list)
list_item = ListItem(List=merge, Index=number, Wrap=True)
curve_3 = Curve(list_item)

# ----
# B. Floor Planner Solver
python_3_script = Python3Script(boundary_crv=curve_3)  # -> boundary_output, rectangles, labels, gross_floor_area, net_floor_area, private_area, common_area, packing_efficiency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; inputs boundary_crv: Curve
# ---------- python_3_script: Python ----------
"""
Grasshopper integration for Cedar Floor Planner
Boundary-driven version with multi-variant packing
"""

import sys
import os
import Rhino.Geometry as rg
import System.Drawing as sd
import Grasshopper

# --------------------------------------------------
# 1️⃣ PROJECT PATH
# --------------------------------------------------

ghdoc = Grasshopper.Instances.ActiveCanvas.Document
gh_path = ghdoc.FilePath

project_root = os.path.dirname(os.path.dirname(gh_path))

gh_path = os.path.join(project_root, "gh")

if gh_path not in sys.path:
    sys.path.append(gh_path)

# --------------------------------------------------
# 2️⃣ IMPORT BACKEND
# --------------------------------------------------

from models.boundary import Boundary
from services.csv_loader import load_rooms_from_csv
from services.packing_engine import pack_rooms
from models.layout import Layout
from services.exporter import export_layout


# --------------------------------------------------
# 3️⃣ CHECK INPUT
# --------------------------------------------------


if boundary_crv is None:

    rooms_geometry = "Draw and connect a rectangle boundary"
    room_label_points = None
    gross_floor_area = None
    net_floor_area = None
    private_area = None
    common_area = None
    packing_efficiency = None

else:

    bbox = boundary_crv.GetBoundingBox(True)

    width = bbox.Max.X - bbox.Min.X
    height = bbox.Max.Y - bbox.Min.Y

    boundary = Boundary(width, height)

# --------------------------------------------------
# 4️⃣ LOAD ROOM PROGRAM
# --------------------------------------------------

    csv_path = os.path.join(project_root, "data", "room_program.csv")

# --------------------------------------------------
# 5️⃣ MULTI VARIANT PACKING
# --------------------------------------------------

    variant_configs = [

        {"rotation": False, "sort_strategy": "area_desc", "aspect_ratio_multiplier": 1.0},
        {"rotation": True,  "sort_strategy": "area_desc", "aspect_ratio_multiplier": 1.0},
        {"rotation": False, "sort_strategy": "area_asc",  "aspect_ratio_multiplier": 1.0},
        {"rotation": True,  "sort_strategy": "area_asc",  "aspect_ratio_multiplier": 1.0},

    ]

    profiles = ["compact", "balanced", "generous"]

    variants = []

    for profile in profiles:

        for config in variant_configs:

            rooms = load_rooms_from_csv(csv_path, profile=profile)

            packed_rooms = pack_rooms(boundary, rooms, config=config)

            layout_variant = Layout(boundary, packed_rooms)

            variants.append({
                "profile": profile,
                "config": config,
                "layout": layout_variant,
                "efficiency": layout_variant.packing_efficiency()
            })


    best_variant = max(variants, key=lambda v: v["efficiency"])

    variant_efficiencies = [v["efficiency"] for v in variants]

    variant_summary = []

    for i, v in enumerate(variants):

        config = v["config"]
        profile = v["profile"]
        eff = v["efficiency"]

        line = f"Variant {i} | profile={profile} | rotation={config['rotation']} | sort={config['sort_strategy']} | efficiency={eff:.3f}"

        variant_summary.append(line)


    selected_variant = variants.index(best_variant)
    variant_summary[selected_variant] += "  ← SELECTED"

    layout = best_variant["layout"]

    layout.selected_profile = best_variant["profile"]
    layout.selected_rotation = best_variant["config"]["rotation"]
    layout.selected_sort = best_variant["config"]["sort_strategy"]
    layout.variants_tested = len(variants)

# --------------------------------------------------
# 6️⃣ EXPORT JSON (ALL VARIANTS)
# --------------------------------------------------

export_path = os.path.join(project_root, "exports", "layout.json")

variants_data = []

for i, v in enumerate(variants):

    layout_variant = v["layout"]

    rooms_data = []

    for room in layout_variant.rooms:

        rooms_data.append({
            "name": room.name,
            "type": room.room_type,
            "category": room.category,
            "target_area": room.target_area,
            "minimum_area": room.min_area,
            "computed_area": room.area(),
            "geometry": {
                "origin": {"x": room.x, "y": room.y},
                "width": room.width,
                "height": room.height
            }
        })

    variants_data.append({
        "index": i,
        "profile": v["profile"],
        "rotation": v["config"]["rotation"],
        "sort_strategy": v["config"]["sort_strategy"],
        "efficiency": v["efficiency"],

        "metrics": {
            "gross_floor_area": layout_variant.boundary.area(),
            "net_floor_area": layout_variant.net_floor_area(),
            "private_area": layout_variant.private_area(),
            "common_area": layout_variant.common_area(),
            "packing_efficiency": layout_variant.packing_efficiency(),
            "private_ratio": layout_variant.private_area() / layout_variant.net_floor_area() if layout_variant.net_floor_area() else 0,
            "common_ratio": layout_variant.common_area() / layout_variant.net_floor_area() if layout_variant.net_floor_area() else 0
        },

        "rooms": rooms_data
    })

export_data = {
    "boundary": boundary.to_dict(),
    "variants": variants_data,
    "selected_variant": selected_variant
}

import json

with open(export_path, "w") as f:
    json.dump(export_data, f, indent=4)

# --------------------------------------------------
# 7️⃣ CREATE RHINO GEOMETRY
# --------------------------------------------------

    rectangles = []
    labels = []
    room_names = []
    room_colors = []

    boundary_height = height

    for room in layout.rooms:

        x = room.x
        y = room.y
        w = room.width
        h = room.height

        flipped_y = boundary_height - (y + h)

        p0 = rg.Point3d(x, flipped_y, 0)
        p1 = rg.Point3d(x + w, flipped_y, 0)
        p2 = rg.Point3d(x + w, flipped_y + h, 0)
        p3 = rg.Point3d(x, flipped_y + h, 0)

        poly = rg.Polyline([p0, p1, p2, p3, p0])
        rectangles.append(poly)

        center = rg.Point3d(x + w / 2, flipped_y + h / 2, 0)
        labels.append(center)

        room_names.append(room.name)

        if room.category == "common":
            room_colors.append(sd.Color.FromArgb(100,180,100))
        else:
            room_colors.append(sd.Color.FromArgb(100,150,220))

# --------------------------------------------------
# 8️⃣ METRICS
# --------------------------------------------------

    gross_floor_area = layout.boundary.area()
    net_floor_area = layout.net_floor_area()
    private_area = layout.private_area()
    common_area = layout.common_area()
    packing_efficiency = layout.packing_efficiency()

# --------------------------------------------------
# OUTPUTS
# --------------------------------------------------

    boundary_output = boundary_crv
    rooms_geometry = rectangles
    room_label_points = labels

    variant_efficiencies_output = variant_efficiencies
    variant_configs_output = variant_configs
    selected_variant_index = selected_variant

    room_names_output = room_names
    room_colors_output = room_colors

    variant_summary_output = variant_summary
# ---------- end python_3_script ----------

number_2 = Number(python_3_script.private_area)
panel = Panel(number_2)

number_3 = Number(python_3_script.packing_efficiency)
panel_2 = Panel(number_3)

data = Data(python_3_script.variant_configs_output)
panel_3 = Panel(data)

number_4 = Number(python_3_script.selected_variant_index)
panel_4 = Panel(number_4)

data_2 = Data(python_3_script.room_colors_output)
panel_5 = Panel(data_2)

# ----
# C. Spatial Metrics
curve_4 = Curve(python_3_script.boundary_output)
panel_6 = Panel(curve_4)

curve_5 = Curve(python_3_script.rectangles)
panel_7 = Panel(curve_5)

point = Point(python_3_script.labels)
panel_8 = Panel(point)

number_5 = Number(python_3_script.gross_floor_area)
panel_9 = Panel(number_5)

number_6 = Number(python_3_script.net_floor_area)
panel_10 = Panel(number_6)

number_7 = Number(python_3_script.common_area)
panel_11 = Panel(number_7)

number_8 = Number(python_3_script.variant_efficiencies_output)
panel_12 = Panel(number_8)

data_3 = Data(python_3_script.room_names_output)
panel_13 = Panel(data_3)

data_4 = Data(python_3_script.variant_summary_output)
panel_14 = Panel(data_4)

# ----
# D. Visualization in rhino
curve_6 = Curve(curve_5)
custom_curve_preview = CustomCurvePreview(Curve=curve_6, Linetype={Path="(Continuous)", Segments=[]}, Colour=ColourSwatch(SwatchColor=RGB(0, 0, 0)))

surface = Surface(curve_5)
data_5 = Data(data_2)
custom_preview = CustomPreview(Geometry=surface, Material=data_5)

curve_7 = Curve(curve_4)
custom_curve_preview_2 = CustomCurvePreview(Curve=curve_7, Linetype={Path="(Continuous)", Segments=[]}, Colour=ColourSwatch(SwatchColor=RGB(0, 0, 0)))

point_2 = Point(point)
data_6 = Data(data_3)
text_tag_3d = TextTag3D(
    Location=point_2,
    Text=data_6,
    Size=Slider(0.25, range=0..1),
    Colour=ColourSwatch(SwatchColor=RGB(0, 0, 0)),
    Justification=5)
